# Grasshopper definition 0116_MeshUnroll.gh (Grasshopper 1.0.7)
# plug-ins: Bifocals, Kangaroo2 Components

mesh = Mesh(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)
clean = CombineClean(Meshes=mesh)
refine = Refine(Mesh=clean, Level=Slider(2, range=1..5))
medges = MeshEdges(Mesh=refine)  # -> NakedEdges, InteriorEdges, NonManifoldEdges
bbox = BoundingBox(Content=refine, Plane=PlaneXY(0, 0, 0), UnionBox=True)  # -> Box, Box_2
nv = NakedVertices(Mesh=refine)  # -> ClothedIndex, NakedIndex, ClothedPts, NakedPts
join = JoinCurves(Curves=medges.NakedEdges, Preserve=False)
volume = Volume(Geometry=bbox.Box)  # -> Volume, Centroid
explode = Explode(Curve=join, Recursive=True)  # -> Segments, Vertices
cullpt = CullDuplicates(Points=explode.Vertices, Tolerance=0.1, CullMode=1)  # -> Points, Indices, Valence
pdecon = Deconstruct(Point=nv.NakedPts)  # -> XComponent, YComponent, ZComponent
vec2pt = Vector2Pt(PointA=volume.Centroid, PointB=cullpt.Points, Unitize=invert(False))  # -> Vector, Length
avr = Average(Input=pdecon.YComponent)
smaller = SmallerThan(FirstNumber=pdecon.YComponent, SecondNumber=avr)  # -> SmallerThan, OrEqualTo
amp = Amplitude(Vector=vec2pt.Vector, Amplitude=Slider(20, range=0..100))
move = Move(Geometry=cullpt.Points, Motion=amp)  # -> Geometry, Transform
dispatch = Dispatch(List=nv.NakedPts, DispatchPattern=smaller.SmallerThan)  # -> ListA, ListB
pline = PolyLine(Vertices=move.Geometry, Closed=invert(False))
entwine = Entwine(Branch00=dispatch.ListA, Branch01=dispatch.ListB, FlattenInputs=True)  # -> simplify(Result)
smoothpline = SmoothPolyline(Polyline=pline, Strength=1, Times=Slider(15, range=0..20))
edgelengths = EdgeLengths(Mesh=refine, LengthFactor=Slider(1, range=0..1), Strength=1)
anchor = Anchor(Point=nv.NakedPts, Strength=10000)
show = Show(G=refine)
oncurve = OnCurve(Points=entwine, Curve=smoothpline, Strength=Slider(100, range=0..100))
entwine_2 = Entwine(Branch00=show, Branch01=oncurve, Branch02=edgelengths, FlattenInputs=True)
solver = Solver(GoalObjects=entwine_2, Reset=Button(), Threshold=1e-15, Tolerance=0.01, On=Toggle(False))  # -> I, V, O
bang = ExplodeTree(Data=solver.O)  # -> Branch0, Branch1, Branch2
mesh_2 = Mesh(bang.Branch0)
stripper = Stripper(Mesh=mesh_2)
unroller = Unroller(Strip=stripper, Unroll=Slider(1, range=0..1))
cluster = Cluster(mesh=unroller)
medges_2 = MeshEdges(Mesh=cluster)  # -> NakedEdges, InteriorEdges, NonManifoldEdges
join_2 = JoinCurves(Curves=medges_2.NakedEdges, Preserve=False)  # -> simplify(Curves)
crv = Curve(graft([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]))
explode_2 = Explode(Curve=join_2, Recursive=True)  # -> Segments, Vertices
bbox_2 = BoundingBox(Content=crv, Plane=PlaneXY(0, 0, 0))  # -> Box, Box_2
curvepoint = PointOnCurve(explode_2.Segments, parameter=0.5)
debox = DeconstructBox(Box=bbox_2.Box)  # -> Plane, X, Y, Z
dedomain = DeconstructDomain(Domain=debox.X)  # -> Start, End
pdecon_2 = Deconstruct(Point=curvepoint)  # -> XComponent, YComponent, ZComponent
subtraction = Subtraction(A=dedomain.End, B=dedomain.Start)
bnd = Bounds(Numbers=pdecon_2.YComponent)
series = Series(Start=0, Step=subtraction, Count=Slider(2, range=1..4))
div = DivideDomain(Domain=bnd, Count="50")
X = UnitX(Factor=series)
item = ListItem(List=div, Index=0, Wrap=True)  # -> Item1, Item
move_2 = Move(Geometry=simplify(crv), Motion=simplify(X))  # -> Geometry, Transform
inc = Includes(Value=pdecon_2.YComponent, Domain=item.Item)  # -> Includes, Deviation
inc_2 = Includes(Value=pdecon_2.YComponent, Domain=item.Item1)  # -> Includes, Deviation
join_3 = JoinCurves(Curves=move_2.Geometry, Preserve=False)
or = GateOr(A=inc.Includes, B=inc_2.Includes)
cull = CullPattern(List=explode_2.Segments, CullPattern=invert(or))
end = EndPoints(Curve=join_3)  # -> Start, End
len = Length(Curve=cull)
dist = Distance(PointA=end.Start, PointB=end.End)
multiplication = Multiplication(A=dist, B=Slider(0.6, range=0.1..1))
division = Division(A=len, B=multiplication)
scale_nu = ScaleNU(Geometry=crv, Plane=PlaneXY(0, 0, 0), ScaleX=division, ScaleY=1, ScaleZ=1)  # -> Geometry, Transform
end_2 = EndPoints(Curve=scale_nu.Geometry)  # -> Start, End
end_3 = EndPoints(Curve=cull)  # -> Start, End
end_4 = EndPoints(Curve=cull)  # -> Start, End
vec2pt_2 = Vector2Pt(PointA=end_2.Start, PointB=end_2.End, Unitize=False)  # -> Vector, Length
vec2pt_3 = Vector2Pt(PointA=end_3.Start, PointB=end_3.End, Unitize=False)  # -> Vector, Length
vec2pt_4 = Vector2Pt(PointA=end_4.End, PointB=end_4.Start, Unitize=False)  # -> Vector, Length
orient = OrientDirection(
    Geometry=scale_nu.Geometry,
    PointA=end_2.Start,
    DirectionA=vec2pt_2.Vector,
    PointB=end_3.Start,
    DirectionB=vec2pt_3.Vector)  # -> Geometry, Transform
orient_2 = OrientDirection(Geometry=scale_nu.Geometry, PointA=end_2.Start, DirectionA=vec2pt_2.Vector, PointB=end_4.End, DirectionB=vec2pt_4.Vector)  # -> Geometry, Transform
bbox_3 = BoundingBox(Content=orient.Geometry, Plane=PlaneXY(0, 0, 0), UnionBox=True)  # -> Box, Box_2
bbox_4 = BoundingBox(Content=orient_2.Geometry, Plane=PlaneXY(0, 0, 0), UnionBox=True)  # -> Box, Box_2
area = Area(Geometry=bbox_3.Box)  # -> Area, Centroid
area_2 = Area(Geometry=bbox_4.Box)  # -> Area, Centroid
smaller_2 = SmallerThan(FirstNumber=area.Area, SecondNumber=area_2.Area)  # -> SmallerThan, OrEqualTo
dispatch_2 = Dispatch(List=orient.Geometry, DispatchPattern=smaller_2.SmallerThan)  # -> ListA, ListB
dispatch_3 = Dispatch(List=orient_2.Geometry, DispatchPattern=smaller_2.SmallerThan)  # -> ListA, ListB
geo = Geometry([dispatch_2.ListB, dispatch_3.ListA])

# ==== cluster Cluster

# ---- group: Cluster Input
mesh = ClusterInput()

# ----
mesh_2 = Mesh(graft(mesh))

# ---- group: laying out
explode = MeshExplode(Mesh=mesh_2, Interpolate=False)
item = ListItem(List=explode, Index=0, Wrap=True)
item_2 = ListItem(List=explode, Index=-1, Wrap=True)
facen = FaceNormals(Mesh=item)  # -> Centers, Normals
facen_2 = FaceNormals(Mesh=item_2)  # -> Centers, Normals
pl = PlaneNormal(Origin=facen.Centers, ZAxis=facen.Normals)
vec2pt = Vector2Pt(PointA=facen.Centers, PointB=facen_2.Centers, Unitize=False)  # -> Vector, Length
align = AlignPlane(Plane=pl, Direction=vec2pt.Vector)  # -> flatten(Plane), Angle
bbox = BoundingBox(Content=mesh_2, Plane=graft(align.Plane))  # -> flatten(Box), Box_2
box_corners = BoxCorners(Box=bbox.Box)  # -> CornerA, CornerB, CornerC, CornerD, CornerE, CornerF, CornerG, CornerH
pl_origin = PlaneOrigin(Base=align.Plane, Origin=box_corners.CornerD)
debox = DeconstructBox(Box=bbox.Box)  # -> Plane, X, Y, Z
dedomain = DeconstructDomain(Domain=debox.Y)  # -> Start, End
xy = XYPlane(Origin=Point(0, 0, 0))
rotate = Rotate(Geometry=xy, Angle=1.570796327, Plane=PlaneXY(0, 0, 0))  # -> Geometry, Transform

# ----
subtraction = Subtraction(A=dedomain.End, B=dedomain.Start)

# ---- group: laying out (continued)
ma = MassAddition(Input=subtraction)  # -> Result, PartialResults
X = UnitX(Factor=ma.PartialResults)

# ----
multiplication = Multiplication(A=X, B=Slider(1.2, range=0..10))

# ---- group: laying out (continued)
neg = Negative(Value=multiplication)
move = Move(Geometry=rotate.Geometry, Motion=neg)  # -> Geometry, Transform
pln = Plane(move.Geometry)

# ----
orient = Orient(Geometry=flatten(mesh_2), Source=pl_origin, Target=pln)  # -> Geometry, Transform

# ---- group: Cluster Output
G = ClusterOutput(orient.Geometry)
